# Dynamo graph Place beams adaptive massing.dyn (Dynamo 2.3.0.5885)

select_face = DSFaceSelection()  # 1 picked in the model
boundingBox = Geometry.BoundingBox(geometry=select_face)
toCuboid = BoundingBox.ToCuboid(boundingBox=boundingBox)
centroid = Solid.Centroid(solid=toCuboid)
width = Cuboid.Width(cuboid=toCuboid)
length = Cuboid.Length(cuboid=toCuboid)
code_block = CodeBlock(w=width, l=length) { w>l; }
code_block_2 = CodeBlock { Vector.XAxis(); Vector.YAxis(); }
if_ = If(test=code_block, true=code_block_2.out0, false=code_block_2.out1)
byOriginNormal = Plane.ByOriginNormal(origin=centroid, normal=if_)
if_2 = If(test=code_block, true=width, false=length)
number = DoubleInput(1000)
code_block_3 = CodeBlock(L=if_2, sp=number) { c = DSCore.Math.Ceiling(L/sp/2); -c*sp..c*sp..sp; }
translate = Geometry.Translate(geometry=byOriginNormal, direction=if_, distance=code_block_3.out1)
intersect = Geometry.Intersect(geometry=select_face, other=translate, lacing=Longest)
levels = Levels("Ground Floor")
structural_framing_types = StructuralFramingTypes("310UB40")
beamByCurve = StructuralFraming.BeamByCurve(curve=intersect, level=levels, structuralFramingType=structural_framing_types, lacing=Longest)
