# Dynamo graph Demo script.dyn (Dynamo 2.3.0.5885)

origin = Point.Origin()
YAxis = Vector.YAxis()
YZ = Plane.YZ()
open_size = IntegerSlider(360, range=0..360 step 1)
segments = IntegerSlider(12, range=4..12 step 1)
code_block = CodeBlock(a=open_size, n=segments) { 0..a..#n; }
rotate = Vector.Rotate(vector=YAxis, plane=YZ, degrees=code_block)
code_block_2 = CodeBlock { 3000; }
python_script = Python(IN[0]=origin, IN[1]=rotate, IN[2]=code_block_2)
# ---------- python_script.python (73 lines) ----------
# Made by Gavin Crump
# Free for use
# BIM Guru, www.bimguru.com.au

# Boilerplate text
import clr

import sys
sys.path.append('C:\Program Files (x86)\IronPython 2.7\Lib')

import System
from System import Array
from System.Collections.Generic import *

clr.AddReference('ProtoGeometry')
from Autodesk.DesignScript.Geometry import *

clr.AddReference("RevitNodes")
import Revit
clr.ImportExtensions(Revit.Elements)
clr.ImportExtensions(Revit.GeometryConversion)

clr.AddReference("RevitServices")
import RevitServices
from RevitServices.Persistence import DocumentManager 
from RevitServices.Transactions import TransactionManager 

clr.AddReference("RevitAPI")
clr.AddReference("RevitAPIUI")

import Autodesk 
from Autodesk.Revit.DB import *
from Autodesk.Revit.UI import *

# Current doc/app/ui
doc = DocumentManager.Instance.CurrentDBDocument
uiapp = DocumentManager.Instance.CurrentUIApplication 
app = uiapp.Application 
uidoc = uiapp.ActiveUIDocument

# Define list/unwrap list functions
def tolist(input):
    result = input if isinstance(input, list) else [input]
    return result

def uwlist(input):
    result = input if isinstance(input, list) else [input]
    return UnwrapElement(input)

# Preparing input from dynamo to revit
origin   = IN[0]
vectors  = IN[1]
distance = IN[2]

start = []
end   = []

# Do some action in a Transaction

p = origin

for v in vectors:
	start.append(p)
	next = Geometry.Translate(p, v, distance)
	p = next
	end.append(next)
	
# Output and Changing element to Dynamo for export
# <element>.ToDSType(True), #Not created in script, mark as Revit-owned
# <element>.ToDSType(False) #Created in script, mark as non-Revit-owned

# Preparing output to Dynamo
OUT = [start, end]
# ----------------------------------------
code_block_3 = CodeBlock(lst=python_script) { s = lst[0]; e = lst[1]; }
byStartPointEndPoint = Line.ByStartPointEndPoint(startPoint=code_block_3.s, endPoint=code_block_3.e)
count = List.Count(list=byStartPointEndPoint)
code_block_4 = CodeBlock(x=count) { x-1; }
takeItems = List.TakeItems(list=byStartPointEndPoint, amount=code_block_4)
XAxis = Vector.XAxis()
number = DoubleInput(2000)
translate = Geometry.Translate(geometry=takeItems, direction=XAxis, distance=number)
list_create = List.Create(item0=takeItems, item1=translate)
transpose = List.Transpose(lists=list_create)
byLoft = Surface.ByLoft(crossSections=transpose)
perimeterCurves = Surface.PerimeterCurves(surface=byLoft)
startPoint = Curve.StartPoint(curve=perimeterCurves)
family_types = FamilyTypes("Adaptive:Typical")
byPoints = AdaptiveComponent.ByPoints(points=startPoint, familyType=family_types)
code_block_5 = CodeBlock { "Rail width"; }
number_2 = DoubleInput(1000)
code_block_6 = CodeBlock(a=open_size, n=segments) { (a/(n-1))/2; }
tan = Math.Tan(angle=code_block_6)
code_block_7 = CodeBlock(h=number_2, a=tan) { h*a; }
code_block_8 = CodeBlock(l=number, e=code_block_7) { (l-(2*e))/2; }
setParameterByName = Element.SetParameterByName(element=byPoints, parameterName=code_block_5, value=code_block_8)
